% Simulink data dictionary data_PMSM_PI.sldd

B = 0
CCR_Counter = 4199
PMSM_CCR_Counter = 4199
Ts = 0.0001
TsModel = 2.5e-5
ADRC_times = 4
b0 = 2000
omega_c = 330
two_omega_c = 85
currunt_omega_c = 350
two_b0 = 2649534
J = 5.8e-5
Pn = 5
Ld = 0.00017
Lq = 0.00017
Ls = 0.00017
Rs = 0.07
flux = 0.00419
speed_bandwidth_LQR = 60
omega_c_LQR = 35
PMSM_current_bandwidth = 1500
current_bandwidth = Simulink.Parameter(1500, StorageClass="Struct", StructName="PI_Para")
PMSM_speed_bandwidth = 200
speed_bandwidth = Simulink.Parameter(200, StorageClass="Struct", StructName="PI_Para")
Over_V = Simulink.Signal()
STOP = Simulink.Signal()
Low_V = Simulink.Signal()
SPEED_P = Simulink.Parameter(0.18457, StorageClass="Struct", StructName="PI_para")
SPEED_I = Simulink.Parameter(18.457, StorageClass="Struct", StructName="PI_para")
CUR_P = Simulink.Parameter(0.255, StorageClass="Struct", StructName="PI_para")
CUR_I = Simulink.Parameter(105, StorageClass="Struct", StructName="PI_para")
Idq_limit = 20